# Grasshopper definition curvature_mapping_example.gh (Grasshopper 1.0.7)
# plug-ins: EleFront, PTComponentLibrary, MeshEdit Components, MetaHopper
# This resource is for educational purposes only. The script is provided as-is as a supplement to training online to assist in deepening insights and understanding on how to use this solution more effectively. 
# Stay curious!

# BIM Academy
# right click, 'set one surface', click surface in main .3dm file that you want to curvature map. then right click, 'enabled'
srf = Surface(<surface referenced from the Rhino model>)  # disabled
srf_2 = Surface(reparameterize(srf))
panel = Panel("50 originally, then 150")
panel_2 = Panel("20 originally")
# gaussian curvature display range set by slider below now instead of to bounds of data. 50 originally
number_slider = Slider(43.735, range=0..500)

# ----
# CONTROL PANEL
# ANALYSIS GRID
toggle_visibility = BooleanToggle(True)
number_of_divisions = Panel("128")

ptsrfdomnum = SurfaceDomainNumber(Surface=srf_2, UNumber=Slider(100, range=1..200), VNumber=Slider(100, range=1..200))
ptcell = Cellulate(Grid=ptsrfdomnum)  # -> Wires, Cells, Meshes
area = MeshArea(Mesh=ptcell.Meshes)  # -> Area, Centroid
srf_cp = SurfaceClosestPoint(Point=area.Centroid, Surface=srf_2)  # -> Point, UVPoint, Distance
curvature = PrincipalCurvature(Surface=srf_2, Point=srf_cp.UVPoint)  # -> Frame, Max, Min, MaxDirection, MinDirection
neg = Negative(Value=number_slider)
multiplication = Multiplication(A=curvature.Max, B=curvature.Min)
wiredisplay = ControlWireDisplay(WireDisplay=2, AllObjects_Object=dom_2)
bnd = Bounds(Numbers=flatten(multiplication))
bnd_2 = Bounds(Numbers=flatten([number_slider, neg]))
range = Range(Domain=Domain(0, 1), Steps=expr("x-1", number_of_divisions))
dom = ConstructDomain(DomainStart=0, DomainEnd=1)
dom_2 = ConstructDomain(DomainStart="0", DomainEnd="1")
# under min and over max shown as clipped (color of each bound)
remap = RemapNumbers(Value=multiplication, Source=bnd_2, Target=dom_2)  # -> Mapped, Clipped
avr = Average(Input=flatten(multiplication))
multiplication_2 = Multiplication(A=area.Area, B=multiplication)  # -> flatten(Result)
# average gaussian curvature in per square mm (1/r^2 for a sphere where r is in mm)
panel_3 = Panel(avr)
# gaussian curvature integral over area
ma = MassAddition(Input=multiplication_2)  # -> Result, PartialResults
div = DivideDomain(Domain=dom_2, Count=number_of_divisions)
panel_4 = Panel(ma.Result)
dedomain = DeconstructDomain(Domain=dom_2)  # -> Start, End
inc = Includes(Value=remap.Clipped, Domain=div)  # -> Includes, Deviation
mindex = MemberIndex(Set=inc.Includes, Member=Toggle(True))  # -> Index, Count
gradient = Gradient(LowerLimit=dedomain.Start, UpperLimit=dedomain.End, Parameter=range, stops=[0: RGB(255, 254, 254), 1: RGB(0, 0, 0)])
pshift = ShiftPaths(Data=mindex.Index, Offset=-1)
colors_picked = ListItem(List=gradient, Index=pshift, Wrap=True)
not = GateNot(A=toggle_visibility)
attributes = DefineObjectAttributes(
    UserKeys="Deflection 2",
    UserValues=multiplication,
    Name="Curvature 2",
    Layer="Curvature 2",
    Color=colors_picked,
    Material=colors_picked)
preview = CustomPreview(Geometry=ptcell.Meshes, Material=colors_picked)
hideshow = HideShowObjectPreview(Visible=not, AllObjects_Object=preview)
hideshow_2 = HideShowObjectPreview(Visible=toggle_visibility)
bake = BakeObjects(Geometry=ptcell.Meshes, Attributes=attributes, Bake=False)
