# Grasshopper definition packing_curvature_example_kidney_shell_colors.gh (Grasshopper 1.0.7)
# plug-ins: Kangaroo2 Components

# number of sphere PAIRS. Slide to increasing numbers to add pairs while scaling up kidney surface mesh.
number_slider = Slider(60, range=60..150)
# set to example kidney surface mesh in rhino by right click, set one mesh, click mesh in rhino. then right click, enabled.
mesh = Mesh(<mesh referenced from the Rhino model>)
random = Random(Range="30", Number=number_slider, Seed=Slider(1.172, range=0..5))
random_2 = Random(Range="30", Number=number_slider, Seed=Slider(3.793, range=0..5))
panel = Panel(random_2)
panel_2 = Panel(random)
number_slider_2 = Slider(3.788, range=0..5)
pt = ConstructPoint(XCoordinate=panel_2, YCoordinate=panel, ZCoordinate=0)
line = LineSDL(Start=pt, Direction="1,1,0", Length=Slider(3, range=0..5))
explode = Explode(Curve=line, Recursive=True)  # -> Segments, flatten(Vertices)
number_slider_3 = Slider(1.11, range=0..2)
division = Division(A=number_slider, B="60")
pt_2 = ConstructPoint(XCoordinate=15, YCoordinate=13, ZCoordinate=0)
length_line = LengthLine(Line=line, Strength=Slider(726.943, range=0..1000))
sc = SphereCollide(Points=explode.Vertices, Radius=number_slider_2, Strength=1)
# scales mesh to simulate kidney growth
pow = Power(A=division, B=Slider(0.309, range=0..2))
msphere = MeshSphere(Base=PlaneXY(0, 0, 0), Radius=Slider(7.707, range=0..15), UCount=10, VCount=20)
# set to 'true' to start simulation
toggle = BooleanToggle(False)
scale = Scale(Geometry=mesh, Center=pt_2, Factor=pow)  # -> Geometry, Transform
sqr = Square(Value=pow)
toggle_2 = BooleanToggle(False)
onmesh = OnMesh(Points=explode.Vertices, Mesh=scale.Geometry, Strength=Slider(726.943, range=0..1000))
entwine = Entwine(Branch00=onmesh, Branch01=sc, FlattenInputs=True)  # -> flatten(Result)
number_slider_4 = Slider(1.639, range=0..5)
stepsolver = StepSolver(
    GoalObjects=[entwine, length_line],
    Tolerance=0.0001,
    Momentum=False,
    Damping=0.99,
    SubIterations=3,
    Animate=Slider(10, range=0..10))  # -> I, V, O; disabled
solver = Solver(GoalObjects=[sc, length_line, onmesh], Reset=Button(), Threshold=1e-15, Tolerance=0.0001, On=toggle)  # -> I, V, O
number_slider_5 = Slider(20, range=0..20)
bang = ExplodeTree(Data=solver.O)  # -> Branch0, Branch1
bang_2 = ExplodeTree(Data=stepsolver.O)  # -> Branch0, Branch1; disabled
division_2 = Division(A=number_slider_2, B=Slider(1.738, range=0..5))
number_slider_6 = Slider(10, range=0..10)
explode_2 = Explode(Curve=bang.Branch1, Recursive=True)  # -> Segments, flatten(Vertices)
len = Length(Curve=explode_2.Segments)
panel_3 = Panel(len)
division_3 = Division(A=number_slider_2, B=Slider(1.639, range=0..5))
dup = DuplicateData(Data=panel_3, Number=2, Order=True)
msphere_2 = MeshSphere(Base=explode_2.Vertices, Radius=division_2, UCount=number_slider_5, VCount=number_slider_5)
explode_3 = Explode(Curve=stepsolver.O, Recursive=True)  # -> Segments, flatten(Vertices)
bnd = Bounds(Numbers=flatten(panel_3))
voronoi³ = Voronoi3D(Points=explode_2.Vertices)  # -> Cells, Boundary; disabled
panel_4 = Panel(dup)
msphere_3 = MeshSphere(Base=explode_3.Vertices, Radius=division_3, UCount=number_slider_6, VCount=number_slider_6)
voronoi³_2 = Voronoi3D(Points=explode_3.Vertices)  # -> Cells, Boundary; disabled
gradient = Gradient(LowerLimit="2.998", UpperLimit="3", Parameter=flatten(panel_4), stops=[0: RGB(233, 0, 0), 1: RGB(255, 255, 255)])
preview = CustomPreview(
    Geometry=msphere_3,
    Material={diffuse=RGB(215, 215, 215), emission=RGB(68, 53, 68), shine=0.5, specular=RGB(255, 254, 254), transparency=0})
preview_2 = CustomPreview(Geometry=msphere_2, Material=gradient)
